# Grasshopper definition main.gh (Grasshopper 1.0.8)

facade_type = ValueList({"One": 1, "Two": 2, "Three": 3, "Four": 4, "Five": 5, "Six": 6, "Seven": 7, "Eight": 8, "Nine": 9, "Ten": 10}, selected="Seven")
sample = Geometry(<extrusion referenced from the Rhino model>)
facadegenerator = Python3Script(
    script=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,
    building_brep=sample,
    floor_height=Slider(4, range=0..10),
    pattern_length=Slider(3, range=0..10),
    pattern_ratio=Slider(0.8, range=0.1..0.9),
    pattern_depth=Slider(0.6, range=0.1..2),
    pattern_type=facade_type,
    bake_block=Toggle(False))  # -> out, walls, glasses, frames; inputs building_brep: Brep, floor_height: Double, pattern_type: Int32, bake_block: Boolean; unedited script template

geometry = Geometry(facadegenerator.glasses)
geometry_2 = Geometry(facadegenerator.walls)

geometry_3 = Geometry(facadegenerator.frames)
custom_preview = CustomPreview(Geometry=geometry_2, Material=ColourSwatch(SwatchColor=RGB(161, 161, 161)))
custom_preview_2 = CustomPreview(Geometry=geometry, Material=ColourSwatch(SwatchColor=RGB(0, 64, 255)))
custom_preview_3 = CustomPreview(Geometry=geometry_3, Material=ColourSwatch(SwatchColor=RGB(255, 71, 71)))
